# Grasshopper definition curl.gh (Grasshopper 1.0.7)

save_upload = Button()
txt = Text(flatten("text to save in a file"))
c_script = CSharpScript(B=save_upload)  # -> out, V; inputs B: Boolean
# ---------- c_script: C# ----------
    // do not scheduleSolution when input is false
    if (!B) output = false;

    if (output)
    {
      GH_Document gh_doc = GrasshopperDocument;
      gh_doc.ScheduleSolution(del, TriggerCallback);
    }
    else
    {
      // input is false OR scheduleSolution has modified the global variable to prevent looping
      V = false;
    }

    // Input false: output is false and then does not execute again
    // Input true: output is true, then scheduleSolution happens and changes to false
    V = output;

    // set up for next value
    output = true;
# ---------- c_script: C# additional code ----------
  int del = 100;
  bool output = false;

  // callback to schedule a fake event, turning the output to false
  void TriggerCallback(GH_Document doc)
  {
    // set to output false on callback
    output = false;
    this.GrasshopperDocument.ExpireSolution();
  }
# ---------- end c_script ----------
homedir = GhPythonScript()  # -> out, a, win_mac
# ---------- homedir: Python ----------
__author__ = "charlieNagamoto"
__version__ = "2022.03.06"

import rhinoscriptsyntax as rs
import os
a = os.path.normpath(os.path.join(os.path.expanduser('~'),"GH_slicer"))
if not os.path.exists(a):
    os.makedirs(a)

if (os.name == "posix"):
    b = 1
else: 
    b = 0
# ---------- end homedir ----------
python = GhPythonScript(x=homedir.a, run=c_script.V)  # -> out, flatten(a); inputs run: Boolean
# ---------- python: Python ----------
__author__ = "peychev"
__version__ = "2018.08.27"

import rhinoscriptsyntax as rs
from System.IO import Directory, Path, SearchOption
# Make persistent variable
if "gcodefiles" not in globals():
    gcodefiles = 0
    
#a = Directory.GetFiles(x)
if (run):
    files = Directory.GetFiles(x)
    files_gcode = [i for i in files if i.endswith('.gcode')]
    gcodefiles = len(files_gcode)
#    a = Directory.GetFiles(x,"*",SearchOption.AllDirectories)

a = gcodefiles
# ---------- end python ----------
filter = StreamFilter(Win_mac=homedir.win_mac, Stream0="\", Stream1="/")
concat = Concatenate(FragmentD=filter, FragmentA="ghSlicer_", FragmentB=python.a, FragmentC=".gcode")
concat_2 = Concatenate(FragmentA=homedir.a, FragmentB=concat)
c_script_2 = CSharpScript(run=c_script.V, File=concat_2, Lines=txt)  # -> done; inputs run: Boolean, File: String, Lines: list of String
# ---------- c_script_2: C# ----------
    done = false;
    if(run){
      //System.IO.File.WriteAllLines(File, Lines, System.Text.Encoding.UTF8);
      System.Text.Encoding utf8WithoutBom = new System.Text.UTF8Encoding(false);
      System.IO.File.WriteAllLines(File, Lines, utf8WithoutBom);

      done = true;
    }
# ---------- end c_script_2 ----------
panel = Panel("curl -p - --insecure  \"ftp://{0}\" --user \"{1}:{2}\" -T \"{3}\" --ftp-create-dirs")
path = FilePath("C:\Windows\System32\curl.exe")
filter_2 = StreamFilter(Gate=homedir.win_mac, Stream0=path, Stream1="curl")
format = Format(Format=panel, Culture=127, Data0="192.168.0.33:21/CurlPutTest/", Data1="user", Data2="password", Data3=concat_2)
python_2 = GhPythonScript(Run=c_script_2, command=format)  # -> out; inputs Run: Boolean
# ---------- python_2: Python ----------
import rhinoscriptsyntax as rs
import subprocess
#args = [arguments]
#print args
if Run:
    #comm = subprocess.Popen([Path] +" "+ args, stdout=subprocess.PIPE)
    process = subprocess.call(command, shell=True)
    #data = comm.communicate()
    
    
    #print data
    #comm.stdout.close()
    #comm.wait()
# ---------- end python_2 ----------
