# Grasshopper definition pulseDO (1).gh (Grasshopper 1.0.7)
# plug-ins: Robots

# command for pulse DO
# const int controller_pin = 2;
# volatile unsigned long pulseInTimeBegin = micros();
# volatile unsigned long pulseInTimeEnd = micros();
# volatile bool newPulseDurationAvailable = false;
# unsigned long pulse = -1;
# 
# 
# 
# void setup() {
#   //Serial.begin(115200);
# 
# 
#   pinMode(controller_pin, INPUT);
#   attachInterrupt(digitalPinToInterrupt(controller_pin),buttonPinInterrupt,CHANGE);
# 
# }
# 
# void loop() {
# 
# 
#   if (newPulseDurationAvailable) {
#     newPulseDurationAvailable = false;
#     unsigned long pulseDuration = pulseInTimeEnd - pulseInTimeBegin;
#     pulse = pulseDuration;
#     Serial.println(pulseDuration);
#   }
# 
# 
# 
# }
# 
# 
# 
# 
# void buttonPinInterrupt()
# {
#   if (digitalRead(controller_pin) == HIGH) {
#     // start measuring
#     pulseInTimeBegin = micros();
#   }
#   else {
#     // stop measuring
#     pulseInTimeEnd = micros();
#     newPulseDurationAvailable = true;
#   }
# }
list = ValueList({"0", "1", "2", "3", "4", "5", "6", "7", "8", "9", "10"}, selected="0")
# arduino code
pulsedo_for_ur = PulseDoForUR(int=list)
target = TargetParameter([null x24])
target_2 = CreateTarget(Target=target, Speed=Slider(30, range=0..100), Command=pulsedo_for_ur, IsCartesian=False)
robotsystem = RobotSystemParameter()

# ---- group: Generate Robot Code
# filter dup. custom commands
program = CreateProgram(Name="DefaultProgram", RobotSystem=robotsystem, Targets1=target_2, StepSize=1)  # -> Program, Code, Duration, Warnings, Errors

# ---- group: cull dup pulse def
cluster = Cluster(txt=program.Code)

# ----
code = Data(cluster)
# better custom uploader (faster)
panel = Panel("192.168.1.11")

resume = Button()
start = Button()
stop = Button()
txt = Text(flatten(code))
upload2 = ScorpionUpload(RobotIP=panel, code=txt, SendProgram=start, pause=stop, resume=resume)  # -> out, a; inputs code: list, SendProgram: Boolean
# ---------- upload2: Python ----------
import socket


if (SendProgram == True):
    openComm ='socket_open("%s",30003)'%(RobotIP)
    Comm =  "  " + openComm
    code.insert(1, Comm)
    msg = "\n".join(code)
    msg = msg + "\n"
    a = msg
    PORT = 30003
    sock = socket.socket(socket.AF_INET, socket.SOCK_STREAM)
    sock.settimeout(1)
    
    try:
        sock.connect((RobotIP, PORT))
        sock.send(msg.encode("utf-8"))
        print("sent")
    except Exception, e:
        print ("socket failed")
        import traceback
        print traceback.format_exc()
        sock.close()

if (pause == True):
    pause = "pause program"+ "\n"
    PORT = 30003
    sock = socket.socket(socket.AF_INET, socket.SOCK_STREAM)
    sock.settimeout(1)
    
    try:
        sock.connect((RobotIP, PORT))
        sock.send(pause.encode("utf-8"))
        print("sent")
    except Exception, e:
        print ("socket failed")
        import traceback
        print traceback.format_exc()
        sock.close()
        
if (resume == True):
    pause = "resume program" + "\n"
    PORT = 30003
    sock = socket.socket(socket.AF_INET, socket.SOCK_STREAM)
    sock.settimeout(1)
    
    try:
        sock.connect((RobotIP, PORT))
        sock.send(pause.encode("utf-8"))
        print("sent")
    except Exception, e:
        print ("socket failed")
        import traceback
        print traceback.format_exc()
        sock.close()
# ---------- end upload2 ----------

# ==== cluster Cluster
txt = ClusterInput()
txt_2 = Text(txt)
lng = ListLength(List=txt_2)
series = Series(Start=0, Step=1, Count=lng)
tmatch = MatchText(Text=txt_2, RegEx="^.*move.*$", Case=False)
cull = CullPattern(List=series, CullPattern=tmatch)
item = ListItem(List=cull, Index=0, Wrap=True)
split = SplitList(List=txt_2, Index=item)  # -> ListA, ListB
cset = CreateSet(List=split.ListA)  # -> Set, Map
merge = Merge(Data1=cset.Set, Data2=split.ListB)
txt_3 = Text(merge)
txt_4 = ClusterOutput(txt_3)

# ==== cluster PulseDoForUR
int = ClusterInput()
num = ClusterInput()

int_2 = Integer(int)
num_2 = Number(num)
panel = Panel("""thread pulse_DO{2}_{1}():
    set_digital_out({2},True)
    sleep({0})
    set_digital_out({2},False)
    return False
  end""")
rep = ReplaceText(Text=num_2, Find=".", Replace="_", RecursiveReplace=False)
format = Format(Format="thrd = run pulse_DO{1}_{0}()", Culture=127, Data0=rep, Data1=int_2)
format_2 = Format(Format=panel, Culture=127, Data0=num_2, Data1=rep, Data2=int_2)
customcmd = CustomCommand(Name="pulse_DO", Manufacturer="UR", Code=format, Declaration=format_2)

C = ClusterOutput(customcmd)
