# Grasshopper definition pulseDO.gh (Grasshopper 1.0.7)
# plug-ins: Robots

list = ValueList({"AA-KR60", "AA-KR30", "AA-KR60_KR30", "AARCH IRB120", "AARCH IRB6620", "AAU-Utzon-UR10", "Automata", "Bartlett-IRB120", "Bartlett-IRB1600", "Bartlett-KR6"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}, selected="CITA-UR5e")
load_robot = LoadRobotSystem(Name=list, Base=PlaneXY(0, 0, 0))
robotsystem = RobotSystemParameter(load_robot)

list_2 = ValueList({"0", "1", "2", "3", "4", "5", "6", "7", "8", "9", "10"}, selected="5")
pulsedo = PulseDo(num=Slider(0.04, range=0..0.1), int=list_2)

target = CreateTarget(Command=pulsedo, IsCartesian=True)

# ---- group: Generate Robot Code
program = CreateProgram(Name="DefaultProgram", RobotSystem=load_robot, Targets1=target, StepSize=1)  # -> Program, Code, Duration, Warnings, Errors

# ---- group: cull dup pulse def
cluster = Cluster(txt=program.Code)

# ==== cluster PulseDo
int = ClusterInput()
num = ClusterInput()

int_2 = Integer(int)
num_2 = Number(num)
panel = Panel("""thread pulse_DO{2}_{1}():
    set_digital_out({2},True)
    sleep({0})
    set_digital_out({2},False)
    return False
  end""")
rep = ReplaceText(Text=num_2, Find=".", Replace="_", RecursiveReplace=False)
format = Format(Format="thrd = run pulse_DO{1}_{0}()", Culture=127, Data0=rep, Data1=int_2)
format_2 = Format(Format=panel, Culture=127, Data0=num_2, Data1=rep, Data2=int_2)
customcmd = CustomCommand(Name="pulse_DO", Manufacturer="UR", Code=format, Declaration=format_2)

C = ClusterOutput(customcmd)

# ==== cluster Cluster
txt = ClusterInput()
txt_2 = Text(txt)
lng = ListLength(List=txt_2)
series = Series(Start=0, Step=1, Count=lng)
tmatch = MatchText(Text=txt_2, RegEx="^.*move.*$", Case=False)
cull = CullPattern(List=series, CullPattern=tmatch)
item = ListItem(List=cull, Index=0, Wrap=True)
split = SplitList(List=txt_2, Index=item)  # -> ListA, ListB
cset = CreateSet(List=split.ListA)  # -> Set, Map
merge = Merge(Data1=cset.Set, Data2=split.ListB)
txt_3 = Text(merge)
txt_4 = ClusterOutput(txt_3)
